% Simulink data dictionary Needed_Buses.sldd

Fault_out = Simulink.Bus()
  VoltSensor: boolean
  UV: boolean
  OT: boolean
  UT: boolean
  OC: boolean
  OV: boolean

Current_Limits = Simulink.Bus()
  Discharge_Current_Limit: single
  Charge_Current_Limit: single

Fault_Level = Simulink.Bus()
  OT: double
  UT: double
  UV: double
  OV: double

From_Plant = Simulink.Bus()
  Vmod: single[12]
  Tmod: single[12]
  Pack_Current: single
  SOCmod: single[12]
  V_Batt_Monitor: single

From_BMS = Simulink.Bus()
  BMS_State_Out: Enum: BMS_State
  Current_Limits: Bus: Current_Limits
  Bal_Cmd: boolean[1 12]